vi "802.11 Send TX ICP.gvi"   [LabVIEW Communications System Design Suite 2.0.1]
# Receives the payload and serializes it into ICP packets. The encoded ICP packets are transmitted to the target TX using the TX Data DMA FIFO.
inputs:
  "FPGA interface": "802.11 FGPA Reference.gtype"  # Interface to the device's FPGA handle.
  "MCS": UFXP(4.0)  # Modulation and coding scheme index. Depending on the current 802.11 format (a or ac) and the bandwidth, valid indexes range from 0 to 7, 8 or 9.
  "device MAC address": u8[6] = [71, 111, 75, 117, 109, 97]  # Device MAC address used in the MAC frame header during transmission.
  "error in": error
  "destination MAC address": u8[6] = [71, 111, 75, 117, 109, 98]  # Destination MAC address used in the MAC frame header during transmission.
  "Flow ID": u8
  "payload": u8[]  # Payload to be transferred to the target MAC TX.
  "format": enum{"a", "ac"} = "a"  # The 802.11 format to use (currently a or ac).
  "bandwidth": enum{"20 MHz", "40 MHz", "80 MHz"} = "20 MHz"  # Bandwidth for the current packet. Enumeration type: 20 MHz, 40 MHz, 80 MHz
outputs:
  "dropped?": bool  # Indicates that the payload was not forwarded to TX Data DMA FIFO because the FIFO was full.
  "error out": error
  "FPGA Interface dup": "802.11 FGPA Reference.gtype"  # Interface to the device's FPGA handle.
diagram:
  # Leave space
  # for more than
  # one A-MPDU.
  Feedback Node(initial value=0xFFFFFFFF, input=w1) -> w2
  Is Greater(x=w2, y=10000) -> w3
  case (w3) {
    frame False, Default {
      # Write empty array
      # to figure out free
      # elements.
      Host Fifo Write Node[FifoName="802.11 AFW Resources.grsc\\H2T TX Data"](data=u8[] [], error in=$"error in", reference in=$"FPGA interface", timeout (ms)=5000) -> (empty elements remaining=w1, error out=w4, reference out=w5)
    }
    frame True {
      w6 = 1  # power level
      w7 = 1  # scrambler seed
      Build Array[ConcatenateInputs=True]($"Flow ID", $payload) -> w8
      # Create MPDU
      call "802.11 PHY Parameter to U8.gvi"(format=$format, bandwidth=$bandwidth, MCS=$MCS) -> (sample=w9)
      Build Array[ConcatenateInputs=True](w9, w6, w7, $"device MAC address", $"destination MAC address", w8) -> w10
      Array Size(array=w10) -> (size(s)=w11)
      To Unsigned Long Integer(number=w11) -> w12
      Split Number(x=w12) -> (high(x)=w13, low(x)=w14)
      # prepend packet size
      Split Number(x=w13) -> (high(x)=w15, low(x)=w16)
      # 01/29/2018 Yue
      # create flow id, and build array with payload
      Split Number(x=w14) -> (high(x)=w17, low(x)=w18)
      Build Array[ConcatenateInputs=True](w15, w16, w17, w18, w10) -> w19
      Host Fifo Write Node[FifoName="802.11 AFW Resources.grsc\\H2T TX Data"](data=w19, error in=$"error in", reference in=$"FPGA interface", timeout (ms)=5000) -> (empty elements remaining=w1, error out=w4, reference out=w5)
    }
  }
  $"FPGA Interface dup" <- w5
  $"error out" <- w4
  Not(x=w3) -> w20
  $"dropped?" <- w20
