vi "Print all traces.gvi"   [LabVIEW Communications System Design Suite 2.0.1]
inputs:
  "custom session": "Custom session.gtype"
  "CCA Busy trace filepath": path
  "start printing?": bool
  "error in": error
  "Chain State trace filepath": path
  "ACK Address trace filepath": path
outputs:
  "error out": error
types:
  T1 = cluster{"Timestamp": u32, "Timing Control State Enum": u32}
  T2 = cluster{"Timestamp": u32, "LSB of MAC Address": u16, "MSB of MAC Address": u16}
  "Custom session.gtype" = cluster{"H2T TX Data FIFO: actual depth": u32, "Track CCA Busy queue": Queue<cluster{"Timestamp": u32, "Busy or Idle": u32}>, "Track Chain State queue": Queue<T1>, "Track Received MAC Address": Queue<T2>}
diagram:
  Property Node(instance in=$"custom session") -> ("Track CCA Busy queue"=w1, "Track Chain State queue"=w2, "Track Received MAC Address"=w3)
  case ($"start printing?") {
    frame False, Default {
      w4 = $"error in"
    }
    frame True {
      Flush Queue(error in=$"error in", queue=w1) -> (error out=w5, remaining elements=w6)
      for {
        w7 = each element of w6
        Property Node(instance in=w7) -> ("Timestamp"=w8, "Busy or Idle"=w9)
        To Unsigned Long Integer(number=w8) -> w10
        Build Array(w10, w9) -> w11
        To Quad Integer(number=w11) -> w12
        call "Write to Spreadsheet File (I64).gvi"(file path=$"CCA Busy trace filepath", 1D data=w12, append to file?=TRUE, delimiter=",", transpose?=FALSE, format="%d")
      }
      Flush Queue(error in=$"error in", queue=w2) -> (error out=w13, remaining elements=w14)
      Flush Queue(error in=$"error in", queue=w3) -> (error out=w15, remaining elements=w16)
      Merge Errors(w5, w13, w15) -> (error out=w4)
      for {
        w17 = each element of w14
        Property Node(instance in=w17) -> ("Timestamp"=w18, "Timing Control State Enum"=w19)
        To Unsigned Long Integer(number=w18) -> w20
        Build Array(w20, w19) -> w21
        To Quad Integer(number=w21) -> w22
        call "Write to Spreadsheet File (I64).gvi"(file path=$"Chain State trace filepath", 1D data=w22, append to file?=TRUE, delimiter=",", transpose?=FALSE, format="%d")
      }
      for {
        w23 = each element of w16
        Property Node(instance in=w23) -> ("Timestamp"=w24, "LSB of MAC Address"=w25, "MSB of MAC Address"=w26)
        To Unsigned Long Integer(number=w24) -> w27
        To Unsigned Long Integer(number=w25) -> w28
        To Unsigned Long Integer(number=w26) -> w29
        Build Array(w27, w28, w29) -> w30
        To Quad Integer(number=w30) -> w31
        call "Write to Spreadsheet File (I64).gvi"(file path=$"ACK Address trace filepath", 1D data=w31, append to file?=TRUE, delimiter=",", transpose?=FALSE, format="%d")
      }
    }
  }
  $"error out" <- w4
