vi "802.11 Host.gvi"   [LabVIEW Communications System Design Suite 2.0.1]
panel controls:
  "Trigger TX": bool
  "Clear events": bool
  "Operation Mode": T2 = "RF Multi Station"
  "Primary Subband": UFXP(2.0) = 1
  "Transmit IP Address": string = "127.0.0.1"
  "Transmit Port": u16 = 12346
  "Receive Port": u16 = 12345
  "Tab": i32 = 1
  "Power Level [dBm]": f64
  "TX Frequency [Hz]": f64 = 2500000000
  "Destination MAC Address": u8[6] = [71, 111, 75, 117, 109, 97]
  "Device MAC Address": u8[6] = [71, 111, 75, 117, 109, 107]
  "TX Port (USRP only)": enum{"TX1/RF 0", "TX1/RF 1"} = "TX1/RF 0"
  "RX Port (USRP only)": T3 = "RX2/RF 1"
  "AGC": bool = TRUE
  "Manual RX gain [dB]": f64 = 37.5
  "PN Data Packet Size": i32 = 2000
  "Subcarrier Format": i32 = "20 MHz (IEEE 802.11 a)"(0)
  "Stop": bool
  "RIO Device": string = "RIO0"
  "Station": bool = TRUE
  "reset TX staistics": bool
  "reset RX staistics": bool
  "PN Packets per Second": u32 = 5000
  "Transmit ACK": bool = TRUE
  "Backoff": u16 = 4
  "All": bool
  "None": bool
  "Events to Track": T5
  "CCA Energy Detection Threshold [dBm]": FXP(10.3) = -72
  "MCS": UFXP(4.0) = 4
  "session": "802.11 Host Session.gtype" = {"PN packet"=[118, 118, 209, 60, 246, 41, 244, 9, 181, 17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], "USRP session"={"Data Clock Rate"=120000000, "Radio Settings Bus Semaphore"=1693450245, "DB Queues"=[refnum, refnum], "Characterization Data Valid?"=TRUE, "EEPROM Header"={"Checksum"=0, "Product Code"=30513, "Hardware Current Version"=6, "Hardware Oldest Compatible Version"=4, "EEPROM Map Current Version"=2, "EEPROM Map Oldest Compatible Version"=2, "User Password"="", "Pointer to Factory Header"=64, "Pointer to User Header"=4294967295, "Recommended Interval"=24, "Number of Reserved Bytes"=9, "Number of Daughterboards"=2, "Daughterboard IDs"=[103, 103], "Daughterboard Serial Numbers"=["F59F67\u0000\u0000\u0000", "F59F67\u0000\u0000\u0000"]}, "Device Data Header"={"Checksum"=0, "Number of Channels"=4, "Number of Gain Settings"=[1, 1, 1, 1], "Pointer to Characterization Data"=[192, 11720, 17512, 29040], "Number of Reserved Bytes"=27, "Number of Frequencies"=[480, 241, 480, 241]}, "EEPROM Characterization Header"={"Checksum"=0, "Date"=2014-09-23T14:38:47Z, "Temperature"=25, "Misc. Info"="", "Pointer to Device Data Header"=128, "Number of Reserved Bytes"=28}, "Characterization Data"=[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], "FPGA Current Version"=3, "FPGA Oldest Compatible Version"=3, "Fixed Logic Current Version"=4, "Fixed Logic Oldest Compatible Version"=1, "FPGA Radio Settings Bus Current Version"=2, "FPGA Radio Settings Bus Oldest Compatible Version"=2, "FPGA Board Config Current Version"=2, "FPGA Board Config Oldest Compatible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
  "Data Source Option": i32 = 1
  "Data Sink Options": i32
  "Data Source": enum{"UDP", "PN Data", "Manual"} = "PN Data"
  "Data Sink": enum{"Off", "UDP"} = "Off"
  "Reference Clock": string = "Internal"
  "USRP bandwidth": "USRP bandwidth.gtype" = "40 MHz"
panel indicators:
  "Events": string
  "MAC TX Statistic": T1
  "Baseband Power": f64
  "Coerced LO frequency TX [Hz]": f64
  "Coerced LO frequency RX [Hz]": f64
  "Channel Estimation": cluster{"Element 1": i32[], "Element 2": f64[]}[]
  "TX Block Error Rate": f64
  "Coerced Power Level [dBm]": f64
  "RX Throughput": f64
  "Applied RX Gain [dB]": f64
  "RX Throughput [bits/s]": f64
  "Current TX Block Error Rate (BLER)": f64
  "RX Frequency [Hz]": f64
  "Overwritten by Device MAC Address": bool
  "Station Active": bool
  "Device Ready": bool
  "Baseband RX Power [dBFS]": f64
  "RX Constellation": c128[]
  "RX Power Spectrum": T4
  "TX Power Spectrum": T4
  "Data Transfer": bool
  "FIFO Full": bool
  "FIFO Full": bool
  "Data Transfer": bool
  "Compensated CFO [Hz]": f64
  "TX Data Dropped": bool
  "modulation and coding rate": string
  "MAC RX Statistic": T10
  "Target FIFO Overflow": bool
  "RF Input Power": f64[][]
types:
  T1 = cluster{"TX after SIFS Requests Detected": u32, "TX after SIFS Requests Completed": u32, "TX after Backoff Requests Detected": u32, "TX after Backoff Requests Completed": u32}
  T2 = enum{"Baseband Loopback", "RF Loopback", "RF Multi Station"}
  T3 = enum{"RX1/RF 0", "RX2/RF 0", "RX1/RF 1", "RX2/RF 1"}
  T4 = cluster{"f0": f64, "df": f64, "magnitude": f64[]}
  T5 = cluster{"PhyTxStart": bool, "PhyTxEnd": bool, "PhyRxStart": bool, "PhyRxEnd": bool, "MacChannelState": bool, "MacTxStatus": bool, "PhyCcaTiming": bool, "PhyCcaTiming_2": bool, "PhyCcaTiming_3": bool}
  T6 = cluster{"Timestamp": u32, "Transferred Bytes": u32}
  T7 = cluster{"fpga ref": any, "bus instance": u32, "instruction FIFO depth": u32, "executing on FPGA target": bool, "show error call chain": bool}
  T8 = cluster{"Actual Gain [dB]": f64, "Attenuation Table Index": i32}
  T9 = cluster{"Attenuation Table [dB]": f64[][], "Frequencies [Hz]": f64[], "IQ Imbalance Table": "niUsrpRio Config v1 Host.lvlib__IQ Imbalance.gtype"[], "Gain Table": T8[][]}
  "niInstr Register Bus v0 Host.lvlib__Register Bus Session.gtype" = Queue<"niInstr Register Bus v0 Host.lvlib__Session Data.gtype">
  "Semaphore RefNum.gtype" = i32
  "niUsrpRio Config v1 Host.lvlib__DB Queue Reference.gtype" = Queue<"niUsrpRio Config v1 Host.lvlib__Daughterboard Data.gtype">
  "niUsrpRio Config v1 Host.lvlib__niUsrpRio Session.gtype" = cluster{"FPGA Interface": any, "RIO Interface Number": u32, "Data Clock Rate": u32, "FPGA Data Clock Rate": u32, "Global Settings Register Bus": "niInstr Register Bus v0 Host.lvlib__Register Bus Session.gtype", "Radio 0 Settings Register Bus": "niInstr Register Bus v0 Host.lvlib__Register Bus Session.gtype", "Radio 1 Settings Register Bus": "niInstr Register Bus v0 Host.lvlib__Register Bus Session.gtype", "Radio Settings Bus Semaphore": "Semaphore RefNum.gtype", "DB Queues": "niUsrpRio Config v1 Host.lvlib__DB Queue Reference.gtype"[], "Characterization Data Valid?": bool, "EEPROM Header": "niUsrpRio Config v1 Host.lvlib__EEPROM Header.gtype", "Device Data Header": "niUsrpRio Config v1 Host.lvlib__EEPROM Device Data Header.gtype", "EEPROM Characterization Header": "niUsrpRio Config v1 Host.lvlib__EEPROM Characterization Header.gtype", "Characterization Data": "niUsrpRio Config v1 Host.lvlib__Characterization Data.gtype"[], "FPGA Current Version": u32, "FPGA Oldest Compatible Version": u32, "Fixed Logic Current Version": u32, "Fixed Logic Oldest Compatible Version": u32, "FPGA Radio Settings Bus Current Version": u32, "FPGA Radio Settings Bus Oldest Compatible Version": u32, "FPGA Board Config Current Version": u32, "FPGA Board Config Oldest Compatible Version": u32, "Daughterboard Clock Rate": u32}
  "802.11 Host Session.gtype" = cluster{"FPGA interface": "802.11 FGPA Reference.gtype", "send queue": Queue<u8[]>, "receive queue": Queue<u8[]>, "receive throughput queue": Queue<T6>, "UDP Receiver": UdpNetworkConnectionRefnum, "PN packet": u8[], "FlexRIO session": Queue<T7>, "FlexRIO TX Characterization Data": T9, "FlexRIO RX Characterization Data": T9, "USRP session": "niUsrpRio Config v1 Host.lvlib__niUsrpRio Session.gtype", "RF loop clock frequency": f64}
  T10 = cluster{"Packet Starts detected": u32, "Frames from PHY": u32, "Frames with FCS pass": u32, "ACKs Received": u32}
  "USRP bandwidth.gtype" = enum{"40 MHz", "120 MHz", "160 MHz"}
  T11 = cluster{"TX after SIFS requests detected": u32, "TX after SIFS requests completed": u32, "TX after backoff requests detected": u32, "TX after backoff requests completed": u32}
  T12 = cluster{"Frames detected": u32, "Subframes received": u32, "Valid subframes received": u32, "ACKs received": u32}
  T13 = cluster{"PhyTxStart": bool, "PhyTxEnd": bool, "PhyRxStart": bool, "PhyRxEnd": bool, "MacChannelState": bool, "MacTxStatus": bool, "PhyCcaTiming": bool, "PhyRxGainChange": bool, "PhyRxAGCStateChange": bool}
  T14 = cluster{"remove header": bool, "block unsupported frame types": bool, "block FCS errors": bool, "block address mismatch": bool, "block header recognize error": bool}
diagram:
  sequence {
    frame 0 {
      $Events <- EmptyString
      $"Device Ready" <- FALSE
      $"Station Active" <- FALSE
      $Station <- FALSE
      $"RX Constellation" <- c128[] []
      $"RX Power Spectrum" <- T4 {all zero or empty}
      $"TX Power Spectrum" <- T4 {all zero or empty}
      $"Channel Estimation" <- cluster{"Element 1": i32[], "Element 2": f64[]}[] []
      $"MAC TX Statistic" <- T11 {all zero or empty}
      $"MAC RX Statistic" <- T12 {all zero or empty}
      $"Current TX Block Error Rate (BLER)" <- 0
      $"RX Throughput [bits/s]" <- 0
      $"Compensated CFO [Hz]" <- 0
      for (N = 51) {
        $"RX Throughput" <- NaN
        $"TX Block Error Rate" <- NaN
        $"Baseband Power" <- NaN
      }
      Initialize Array(element=NaN, size=51, size=2) -> w1
      $"RF Input Power" <- w1
    }
  }
  call "Create Stop Notifier.gvi"(error in=no error) -> (error out=w2)
  call "802.11 Host Init.gvi"(device=$"RIO Device", error in=w2, reference clock=$"Reference Clock", USRP bandwidth=$"USRP bandwidth") -> (session out=w3, error out=w4)
  case (w4) {
    frame Error {
      w5 = w4
    }
    frame No Error {
      $"Device Ready" <- TRUE
      $session <- w3
      w5 = w4
    }
  }
  s1 = w5  # shift register
  while {
    # RX Reception
    call "802.11 Unbundle Session.gvi"(session=$session) -> (FPGA interface=w6, receive queue=w7, receive throughput queue=w8)
    call "802.11 Receive RX ICP.gvi"(FPGA interface=w6, error in=s1, receive queue=w7, receive throughput queue=w8, enqueue decoded data=$"Station Active") -> (error out=w9)
    call "Check Stop.gvi"(error in=w9) -> (error out=w10, stop=w11)
    Wait Until Next Multiple(multiple to wait=0)
    next s1 = w10
    stop if w11
  }
  call "Stop On Error.gvi"(error in=s1) -> (error out=w12)
  s2 = w5  # shift register
  s3 = string[] []  # shift register
  while {
    call "802.11 Unbundle Session.gvi"(session=$session) -> (FPGA interface=w13)
    call "802.11 Prepare Constellation.gvi"(FPGA interface=w13, error in=s2, maximal number of subcarriers=4800) -> (error out=w14, data field constellation=w15, update constellation=w16)
    # update plots and indicators (slow)
    Logical And($"Station Active", w16) -> w17
    case (w17) {
      frame False { }
      frame True {
        $"RX Constellation" <- w15
      }
    }
    call "802.11 Read Event FIFO.gvi"(FPGA interface=w13, error in=s2) -> (raw events=w18, error out=w19)
    call "802.11 Prepare RX Power Spectrum.gvi"(FPGA interface=w13, error in=s2) -> (error out=w20, RX power spectrum=w21, update power spectrum=w22)
    call "802.11 Prepare TX Power Spectrum.gvi"(FPGA interface=w13, error in=s2) -> (error out=w23, TX power spectrum=w24, update power spectrum=w25)
    call "802.11 Prepare Channel Estimation.gvi"(FPGA interface=w13, error in=s2, channel subband=$"Primary Subband", subcarrier format=$"Subcarrier Format") -> (error out=w26, channel estimation=w27, update power spectrum=w28)
    call "802.11 Read Target Registers.gvi"(FPGA interface=w13, error in=s2) -> (error out=w29, target FIFO overflow=w30, compensated CFO=w31, RF input power=w32, MAC RX statistics=w33, MAC TX statistics=w34, signal power at packet start=w35)
    Merge Errors(w14, w20, w23, w26, w29, w19) -> (error out=w36)
    call "Check Stop.gvi"(error in=w36) -> (error out=w37, stop=w38)
    Logical And($"Station Active", w22) -> w39
    case (w39) {
      frame False, Default { }
      frame True {
        $"RX Power Spectrum" <- w21
      }
    }
    Logical And($"Station Active", w25) -> w40
    case (w40) {
      frame False, Default { }
      frame True {
        $"TX Power Spectrum" <- w24
      }
    }
    Logical And($"Station Active", w28) -> w41
    case (w41) {
      frame False, Default { }
      frame True {
        $"Channel Estimation" <- w27
      }
    }
    $"Target FIFO Overflow" <- w30
    $"Compensated CFO [Hz]" <- w31
    $"RF Input Power" <- w32
    $"Baseband Power" <- w35
    $"MAC RX Statistic" <- w33
    $"MAC TX Statistic" <- w34
    call "802.11 Events to String.gvi"(event data=w18, events to track=$"Events to Track") -> (event strings=w42)
    for {
      w43 = each element of w42
      Match Pattern(regular expression="PhyRxStart.ind ", string=w43) -> (offset past match=w45)
      Is Not Equal(x=w45, y=-1) -> w46
      append w46 to w44
    }
    Or Array Elements(Boolean array=w44)
    w47 = -12  # CFX data type offset
    Add(w35, w47) -> w48
    $"Baseband RX Power [dBFS]" <- w48
    Build Array[ConcatenateInputs=True](s3, w42) -> w49
    Delete From Array(inArray=w49, length (1)=10000) -> (deleted=w50)
    Select(s=$"Clear events", t=string[] [], f=w50) -> w51
    Concatenate Strings(w50) -> w52
    $Events <- w52
    Select(s=$None, t=T13 {all zero or empty}, f=$"Events to Track") -> w53
    w54 = T13 {"PhyTxStart"=TRUE, "PhyTxEnd"=TRUE, "PhyRxStart"=TRUE, "PhyRxEnd"=TRUE, "MacChannelState"=TRUE, "MacTxStatus"=TRUE, "PhyCcaTiming"=TRUE, "PhyRxGainChange"=TRUE, "PhyRxAGCStateChange"=TRUE}
    Select(s=$All, t=w54, f=w53) -> w55
    $"Events to Track" <- w55
    Wait Until Next Multiple(multiple to wait=250)
    next s2 = w37
    next s3 = w51
    stop if w38
  }
  call "Stop On Error.gvi"(error in=s2) -> (error out=w56)
  s4 = w5  # shift register
  while {
    Feedback Node(input=$"Station Active") -> w57
    Is Not Equal(x=$"Station Active", y=w57) -> w58
    # update plots and indicators (fast)
    case ($"Station Active") {
      frame False, Default {
        w59 = s4
      }
      frame True {
        call "802.11 Unbundle Session.gvi"(session=$session) -> (FPGA interface=w60, receive throughput queue=w61)
        call "802.11 Prepare Throughput Measurements.gvi"(reset=w58, FPGA interface=w60, receive throughput queue=w61, error in=s4, timing granularity=100) -> (error out=w59, TX block error rate=w62, RX throughput=w63)
        $"Current TX Block Error Rate (BLER)" <- w62
        $"TX Block Error Rate" <- w62
        $"RX Throughput [bits/s]" <- w63
        Divide(x=w63, y=1000000) -> w64
        $"RX Throughput" <- w64
      }
    }
    call "Check Stop.gvi"(error in=w59) -> (error out=w65, stop=w66)
    Wait Until Next Multiple(multiple to wait=100)
    next s4 = w65
    stop if w66
  }
  call "Stop On Error.gvi"(error in=s4) -> (error out=w67)
  Udp Open(error in=w5, net address=0, port=0, service name="", timeout ms=25000) -> (connection ID=w68, error out=w69)
  call "Set Socket Option.gvi"(connection in=w68, level=0xFFFF, option name=0x1001, value=1024000, error in=w69) -> (error out=w70, connection out=w71)
  s5 = w70  # shift register
  s6 = w71  # shift register
  while {
    # UDP send and receive
    call "802.11 Unbundle Session.gvi"(session=$session) -> (send queue=w72, receive queue=w73, UDP receiver=w74, PN packet=w75)
    case ($"Station Active") {
      frame False, Default {
        w76 = s5
        w77 = s6
      }
      frame True {
        Array Subset(array=w75, length0=$"PN Data Packet Size") -> w78
        case ($"Data Source") {
          frame "UDP" {
            # UDP
            call "802.11 Receive UDP Data.gvi"(UDP receiver=w74, send queue=w72, error in=s5) -> (data transfer=w80, error out=w79, FIFO full=w81)
            $"FIFO Full" <- w81
          }
          frame "PN Data" {
            # PN data
            call "802.11 Send PN Data.gvi"(PN packets per second=$"PN Packets per Second", send queue=w72, PN data=w78, error in=s5) -> (data transfer=w80, error out=w79)
          }
          frame "Manual", Default {
            # Manual
            case ($"Trigger TX") {
              frame False, Default {
                w79 = s5
                w80 = $"Trigger TX"
              }
              frame True {
                Enqueue Element(element=w78, error in=s5, queue=w72, timeout in ms=-1) -> (error out=w79, queue out=w82)
                w80 = $"Trigger TX"
              }
            }
          }
        }
        $"Data Transfer" <- w80
        Is Equal(x=$"Data Sink", y="UDP") -> w83
        call "802.11 Send UDP Data.gvi"(target port=$"Transmit Port", target IP address=$"Transmit IP Address", receive queue=w73, UDP sender=s6, enable=w83, error in=s5) -> (FIFO full=w84, error out=w85, UDP sender dup=w77, data transfer=w86)
        $"Data Transfer" <- w86
        $"FIFO Full" <- w84
        Merge Errors(w79, w85) -> (error out=w76)
      }
    }
    call "Check Stop.gvi"(error in=w76) -> (error out=w87, stop=w88)
    Wait Until Next Multiple(multiple to wait=0)
    next s5 = w87
    next s6 = w77
    stop if w88
  }
  call "Stop On Error.gvi"(error in=s5) -> (error out=w89)
  Udp Close(connection ID=s6, error in=w89) -> (error out=w90)
  s7 = w5  # shift register
  while {
    # TX transmission
    call "802.11 Unbundle Session.gvi"(session=$session) -> (FPGA interface=w91, send queue=w92)
    w93 = $"Station Active"
    while {
      Dequeue Element(error in=s7, queue=w92, timeout in ms=0) -> (element=w94, error out=w95, timed out?=w96)
      Logical And(w93, not w96) -> w97
      case (w97) {
        frame False {
          w98 = w95
        }
        frame True {
          call "802.11 Subcarrier Format to Configuration.gvi"(MCS=$MCS, subcarrier format=$"Subcarrier Format", error in=w95) -> (error out=w99, format=w100, bandwidth=w101, valid configuration=w102)
          Is Not Equal(x=$"Operation Mode", y="RF Multi Station") -> w103
          Select(s=w103, t=$"Device MAC Address", f=$"Destination MAC Address") -> w104
          case (w102) {
            frame False, Default {
              w105 = FALSE
              w98 = w99
            }
            frame True {
              call "802.11 Send TX ICP.gvi"(FPGA interface=w91, MCS=$MCS, device MAC address=$"Device MAC Address", error in=w99, destination MAC address=w104, payload=w94, format=w100, bandwidth=w101) -> (dropped?=w105, error out=w98)
            }
          }
          $"TX Data Dropped" <- w105
          $"Overwritten by Device MAC Address" <- w103
        }
      }
      call "Check Stop.gvi"(error in=w98) -> (error out=w106, stop=w107)
      Logical Or(w107, w96) -> w108
      stop if w108
    }
    call "Check Stop.gvi"(error in=w106) -> (error out=w109, stop=w110)
    Wait Until Next Multiple(multiple to wait=0)
    next s7 = w109
    stop if w110
  }
  call "Stop On Error.gvi"(error in=s7) -> (error out=w111)
  s8 = w5  # shift register
  while {
    # configuration
    call "802.11 Unbundle Session.gvi"(session=$session) -> (FPGA interface=w112)
    Feedback Node(input=$"Station Active") -> w113
    case ($"Station Active") {
      frame False, Default {
        w114 = s8
      }
      frame True {
        Is Not Equal(x=$"Station Active", y=w113) -> w115
        call "802.11 Gain Control.gvi"(initialize=w115, RX Port (USRP only)=$"RX Port (USRP only)", session=$session, AGC=$AGC, error in=s8, Manual RX gain [dB]=$"Manual RX gain [dB]", RX Frequency [Hz]=$"RX Frequency [Hz]", TX Port (USRP only)=$"TX Port (USRP only)") -> (Applied RX Gain [dB]=w116, error out=w117)
        $"Applied RX Gain [dB]" <- w116
        call "802.11 Subcarrier Format to Configuration.gvi"(MCS=$MCS, subcarrier format=$"Subcarrier Format", error in=s8) -> (error out=w118, format=w119)
        call "802.11 Configure Dynamic Parameters.gvi"(FPGA interface=w112, error in=w118, format=w119, transmit ACK=$"Transmit ACK", backoff value=$Backoff, CCA energy detection threshold=$"CCA Energy Detection Threshold [dBm]") -> (error out=w120)
        Merge Errors(w117, w120) -> (error out=w114)
      }
    }
    w121 = $Station
    Feedback Node(input=w121) -> w122
    Logical Exclusive Or(w121, w122) -> w123
    case (w123) {
      frame False, Default {
        w124 = s8
      }
      frame True {
        case (w121) {
          frame False, Default {
            sequence {
              frame 0 {
                $"Station Active" <- w121
              }
            }
            call "802.11 Unbundle Session.gvi"(session=$session) -> (UDP receiver=w125)
            Udp Close(connection ID=w125, error in=s8) -> (error out=w126)
            call "Clear Errors.gvi"(specific error code to clear=1, error in=w126) -> (error out=w127)
            call "802.11 Abort RF Streams.gvi"(session=$session, error in=w127) -> (error out=w124)
          }
          frame True {
            $"RX Frequency [Hz]" <- $"TX Frequency [Hz]"
            call "802.11 FPGA Target Configuration.gvi"() -> (maximum gain=w128, enable DC offset correction=w129)
            w130 = T14 {"remove header"=TRUE, "block unsupported frame types"=TRUE, "block FCS errors"=TRUE, "block address mismatch"=TRUE, "block header recognize error"=TRUE}
            call "802.11 Configure Static Parameters.gvi"(session in=$session, error in=s8, primary subband=$"Primary Subband", operation mode=$"Operation Mode", enable DC offset correction=w129, MPDU filter configuration=w130, device MAC address=$"Device MAC Address") -> (session dup=w131, error out=w132)
            call "802.11 Reset Statistics.gvi"(session in=w131, error in=w132, reset RX statistics=TRUE, reset TX statistics=TRUE) -> (error out=w133, session dup=w134)
            call "802.11 Configure TX RF.gvi"(TX port=$"TX Port (USRP only)", session=w134, TX frequency=$"TX Frequency [Hz]", TX power level=$"Power Level [dBm]", error in=w133) -> (session dup=w135, error out=w136, coerced TX power level=w137, coerced LO frequency=w138)
            call "802.11 Configure RX RF.gvi"(RX frequency=$"TX Frequency [Hz]", session=w135, RX gain=w128, error in=w136, RX port=$"RX Port (USRP only)") -> (error out=w139, session dup=w140, coerced RX gain=w141, coerced LO frequency=w142)
            call "802.11 Configure AGC Registers.gvi"(TX Port=$"TX Port (USRP only)", enable AGC=FALSE, session=w140, RX port=$"RX Port (USRP only)", error in=w139) -> (error out=w143, session dup=w144)
            call "802.11 Set Power Calibration Offset.gvi"(session=w144, frequency=$"TX Frequency [Hz]", error in=w143, RX port=$"RX Port (USRP only)") -> (session dup=w145, error out=w146)
            call "802.11 Configure RF Streams.gvi"(TX port=$"TX Port (USRP only)", RX port=$"RX Port (USRP only)", session=w145, error in=w146) -> (session dup=w147, error out=w148)
            call "802.11 Configure Data Source.gvi"(error in=w148, receive port=$"Receive Port", session in=w147) -> (error out=w124, session out=w149, success?=w150)
            $session <- w149
            sequence {
              frame 0 {
                $Station <- w150
                $"Station Active" <- w121
              }
            }
            $"Coerced LO frequency RX [Hz]" <- w142
            $"Applied RX Gain [dB]" <- w141
            $"Coerced LO frequency TX [Hz]" <- w138
            $"Coerced Power Level [dBm]" <- w137
          }
        }
      }
    }
    call "802.11 Reset Statistics.gvi"(session in=$session, error in=s8, reset RX statistics=$"reset RX staistics", reset TX statistics=$"reset TX staistics") -> (error out=w151)
    call "802.11 Subcarrier Format to Configuration.gvi"(MCS=$MCS, subcarrier format=$"Subcarrier Format", error in=w151) -> (modulation and coding rate=w152, error out=w153)
    Merge Errors(w114, w124, w153) -> (error out=w154)
    call "Create Stop.gvi"(error in=w154, stop in=$Stop) -> (error out=w155)
    call "Check Stop.gvi"(error in=w155) -> (error out=w156, stop=w157)
    Wait Until Next Multiple(multiple to wait=100)
    $"modulation and coding rate" <- w152
    next s8 = w156
    stop if w157
  }
  call "Stop On Error.gvi"(error in=s8) -> (error out=w158)
  Merge Errors(w158, w111, w12, w90, w56, w67) -> (error out=w159)
  sequence {
    frame 0 {
      w160 = $session
    }
  }
  call "802.11 Host Release.gvi"(session=w160, error in=w159) -> (error out=w161)
  call "Simple Error Handler.gvi"(type of dialog="OK message", error in=w161)
